# Grasshopper definition 500_point_a.ghx (Grasshopper 1.0.8)

pt = Point(Point(3.078502653, -9.537846191, 0))
py3 = Python3Script(x=pt, y=Slider(1, range=0..1))  # -> out, a; inputs x: Point3d, y: Double
# ---------- py3: Python ----------
"""Grasshopper Script"""

#! python 3
# r: compas, compas_cgal==0.9.1, compas_libigl==0.7.4, tessagon
# venv: aa
# ---------- end py3 ----------
