# Grasshopper definition 502_frame_a.ghx (Grasshopper 1.0.8)

py3 = Python3Script()  # -> out, a, b
# ---------- py3: Python ----------
"""Grasshopper Script"""

#! python 3
# r: compas, compas_cgal==0.9.1, compas_libigl==0.7.4, tessagon
# venv: aa
# ---------- end py3 ----------
panel = Panel(py3.a)
