# Grasshopper definition 504_remesh_a.ghx (Grasshopper 1.0.8)

pt = Point([Point(0, 0, 0), Point(10, 0, 0), Point(10, 10, 0), Point(0, 10, 0)])
mesh = Mesh(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)
py3 = Python3Script(m=mesh, p=pt)  # -> out, a; inputs m: Mesh, p: list of Point3d
# ---------- py3: Python ----------
"""Grasshopper Script"""

#! python 3
# r: compas, compas_cgal==0.9.1, compas_libigl==0.7.4, tessagon
# venv: aa
# ---------- end py3 ----------
