# Grasshopper definition 500_point.ghx (Grasshopper 1.0.8)

pt = Point(Point(3.078502653, -9.537846191, 0))
py3 = Python3Script(x=pt, y=Slider(1, range=0..1))  # -> out, a; inputs x: Point3d, y: Double
# ---------- py3: Python ----------
"""Grasshopper Script"""

#! python 3
# r: compas, compas_cgal==0.9.1, compas_libigl==0.7.4, tessagon
# venv: aa

from compas.geometry import Point
from compas_rhino.conversions import point_to_compas
from compas_rhino.conversions import point_to_rhino

p = point_to_compas(x)
p += [0,0,y]

a = point_to_rhino(p)
# ---------- end py3 ----------
