# Grasshopper definition 501_box.ghx (Grasshopper 1.0.8)

py3 = Python3Script()  # -> out, a
# ---------- py3: Python ----------
"""Grasshopper Script"""

#! python 3
# r: compas, compas_cgal==0.9.1, compas_libigl==0.7.4, tessagon
# venv: aa

from compas.geometry import Box
from compas_rhino.conversions import box_to_rhino

# Create a box
box = Box(1)

a = box_to_rhino(box)
# ---------- end py3 ----------
panel = Panel(py3.a)
