# Grasshopper definition 502_frame.ghx (Grasshopper 1.0.8)

py3 = Python3Script()  # -> out, a, b
# ---------- py3: Python ----------
"""Grasshopper Script"""

#! python 3
# r: compas, compas_cgal==0.9.1, compas_libigl==0.7.4, tessagon
# venv: aa

from compas.geometry import Box
from compas.geometry import Frame
from compas_rhino.conversions import frame_to_rhino
from compas_rhino.conversions import box_to_rhino

# Create a frame
frame = Frame([0, 0, 0], [1, 1, 1], [0, 1, 0])

# Create a box
box = Box(1, 2, 3, frame=frame)

a = frame_to_rhino(frame)
b = box_to_rhino(box)
# ---------- end py3 ----------
panel = Panel(py3.a)
