# Grasshopper definition 503_geometries.ghx (Grasshopper 1.0.8)

pt = Point(Point(3.078502653, -9.537846191, 0))
py3 = Python3Script(x=pt, y=Slider(0, range=0..1))  # -> out, a, b, c, d, e; inputs x: Point3d, y: Double
# ---------- py3: Python ----------
"""Grasshopper Script"""

#! python 3
# r: compas, compas_cgal==0.9.1, compas_libigl==0.7.4, tessagon
# venv: aa

from compas.geometry import Box
from compas.geometry import Sphere
from compas.geometry import Point
from compas.geometry import Line
from compas.geometry import Frame
from compas_rhino.conversions import box_to_rhino
from compas_rhino.conversions import sphere_to_rhino
from compas_rhino.conversions import point_to_rhino
from compas_rhino.conversions import line_to_rhino
from compas_rhino.conversions import frame_to_rhino
from compas_rhino.conversions import point_to_compas

# Add a box
box = Box(1, 2, 3, frame=Frame([0, 0, 0]))

# Add a sphere
sphere = Sphere(2, Frame([5, 0, 0]))

# Add frame
frame = Frame([0, 0, 0], [1, 1, 1], [0, 1, 0])

# Add a point
point = Point(10, 0, 0)

# Add a line
line = Line([15, 0, 0], [15, 0, 5])

a = box_to_rhino(box)
b = sphere_to_rhino(sphere)
c = frame_to_rhino(frame)
d = point_to_rhino(point)
e = line_to_rhino(line)
# ---------- end py3 ----------
panel = Panel([py3.a, py3.b, py3.c, py3.d, py3.e])
