# Grasshopper definition 504_remesh.ghx (Grasshopper 1.0.8)

pt = Point([Point(0, 0, 0), Point(10, 0, 0), Point(10, 10, 0), Point(0, 10, 0)])
mesh = Mesh(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)
py3 = Python3Script(m=mesh, p=pt)  # -> out, a; inputs m: Mesh, p: list of Point3d
# ---------- py3: Python ----------
"""Grasshopper Script"""

from compas.datastructures import Mesh
from compas_rhino.conversions import mesh_to_compas
from compas_rhino.conversions import mesh_to_rhino
from compas_cgal.meshing import trimesh_dual

mesh = mesh_to_compas(m)

fixed_vertices = []
for point in p:
    for v in mesh.vertices():
        mesh_point = mesh.vertex_point(v)
        if mesh_point.distance_to_point(point) < 0.01:
            fixed_vertices.append(v)
            break


V, F, DV, DF = trimesh_dual(
    mesh.to_vertices_and_faces(True),
    length_factor=1,
    number_of_iterations=10,
    angle_radians=0.9,
    scale_factor=1.0,
    fixed_vertices = fixed_vertices
)

trimesh = Mesh.from_vertices_and_faces(DV, DF)
trimesh.unify_cycles()

a = mesh_to_rhino(trimesh)
# ---------- end py3 ----------
