# Grasshopper definition 700_nesting.ghx (Grasshopper 1.0.8)
# plug-ins: opennest_2 Info

nest_options = Options(
    Rotations=Slider(4, range=0..360),
    Wiggle=Slider(0, range=0..5.01),
    PlacementType=Slider(0, range=0..2),
    Spacing=Slider(0, range=0..100),
    Seed=Slider(30, range=0..100),
    SimplifyTolerance=Slider(1, range=0.01..10),
    Mutation=Slider(10, range=1..100),
    Population=Slider(10000, range=1..100000),
    Time=Slider(0, range=0..120),
    SheetFont="MecSoft_Font 0.025")

# ---- group: Mesh Shadow
mesh = Mesh([<mesh referenced from the Rhino model> x66])
mshadow = MeshShadow(Mesh=mesh, Light=Vector(0, 0, -1), Plane=PlaneXY(0, 0, 0))
offset = OffsetCurve(Curve=mshadow, Distance=0.1, Corners=1)

# ----
id = Guid([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])
geometry_rhino = GeometryRhino(Layer="Outline", Copies="1", Simplify=[100, 0], Sort=Slider(0, range=-1..1), Guid=id)  # -> Geometry, Borders, BC, Groups, All

crv = Curve(<curve referenced from the Rhino model>)
sheets = Sheets(Polylines=crv, Gap=0.1)  # -> Sheets, Polylines
opennest2 = OpenNest2(Sheets=sheets.Sheets, Geometry=geometry_rhino.Geometry, Options=nest_options, Iterations=1, Run=Toggle(True))  # -> Sheets, Borders, AllGeometry, Transforms, SheetId, SheetTxt, Attributes
geo = Geometry(opennest2.SheetTxt)
geo_2 = Geometry(opennest2.AllGeometry)
