# Grasshopper definition opennest2_8_region_slits.gh (Grasshopper 1.0.8)
# plug-ins: opennest_2 Info

# ----
# Region Slits component, just because the default Grasshopper one is buggy...
number_slider = Slider(5, range=0..10)
crv = Curve([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])
rslits = RegionSlits(Regions=crv, Width=Slider(10, range=0..10), Gap=number_slider)  # -> Regions, Topology
