# Grasshopper definition 700_nesting_guid_transformation.ghx (Grasshopper 1.0.8)
# plug-ins: opennest_2 Info

# ---- group: Outline Border
mesh = Mesh([<mesh referenced from the Rhino model> x66])
mshadow = MeshShadow(Mesh=mesh, Light=Vector(0, 0, -1), Plane=PlaneXY(0, 0, 0))
offset = OffsetCurve(Curve=mshadow, Distance=0.1, Corners=1)

# ----
geometry_guid = Guid()
geometry_rhino = GeometryRhino(Layer="Outline", Copies="1", Simplify=[100, 0], Sort=Slider(0, range=-1..1), Guid=geometry_guid)  # -> Geometry, Borders, BC, Groups, All

sheets = Curve()
sheets_2 = Sheets(Polylines=sheets, Gap=0.1)  # -> Sheets, Polylines
opennest2 = OpenNest2(
    Sheets=sheets_2.Sheets,
    Geometry=geometry_rhino.Geometry,
    Options=["num_of_rotations 4", "wiggle 0", "placement_type 0", "spacing 0", "seed 30", "simplify_tolerance 1", "mutation 10", "population 10000", "time 0", "MecSoft_Font-1 -0.01"],
    Iterations=1,
    Run=Toggle(True))  # -> Sheets, Borders, AllGeometry, Transforms, SheetId, SheetTxt, Attributes
item = ListItem(List=geometry_guid, Index=geometry_rhino.Groups, Wrap=True)
geo = Geometry(opennest2.AllGeometry)
tguid = TransformGuid(Guid=item, Transform=opennest2.Transforms, Run=Toggle(False))
